# Grasshopper definition testing_workbench.ghx (Grasshopper 1.0.7)
# plug-ins: jSwan, brain_ghplugin

openai_api_key = CSharpScript()  # -> out, key
# ---------- openai_api_key: C# ----------
    key = Environment.GetEnvironmentVariable("OPENAI_API_KEY");
# ---------- end openai_api_key ----------
panel = Panel("""{
    "model": "text-davinci-003",
    "prompt": "Tell me a fairy tale",
    "max_tokens": 16,
    "temperature": 0
}""")
panel_2 = Panel("https://api.openai.com/v1/completions")
concatenate = Concatenate(FragmentA="Bearer ", FragmentB=openai_api_key.key)
number_slider = Slider(10000, range=0..10000)
httppostrequest_async = HTTPPostRequestAsync(
    Send=Toggle(False),
    Url=panel_2,
    Body=panel,
    ContentType="application/json",
    Authorization=concatenate,
    Timeout=number_slider)
httppostrequest = HTTPPostRequestComponent(
    Send=Toggle(False),
    Url=panel_2,
    Body=panel,
    ContentType="application/json",
    Authorization=concatenate,
    Timeout=number_slider)
deserialize_json = DeserializeJson(JSON=httppostrequest, OutputsLocked=False)  # -> Id, Object, Created, Model, Choices, Usage
deserialize_json_2 = DeserializeJson(JSON=httppostrequest_async, OutputsLocked=False)  # -> Id, Object, Created, Model, Choices, Usage
panel_3 = Panel(httppostrequest_async)
deserialize_json_3 = DeserializeJson(JSON=deserialize_json.Choices, OutputsLocked=False)  # -> Text, Index, Logprobs, Finish_reason
deserialize_json_4 = DeserializeJson(JSON=deserialize_json_2.Choices, OutputsLocked=False)  # -> Text, Index, Logprobs, Finish_reason
panel_4 = Panel(deserialize_json_3.Text)
panel_5 = Panel(deserialize_json_4.Text)
